# Grasshopper definition wafflizer.gh (Grasshopper 1.0.7)
# plug-ins: LunchBox

# ---- group: mesh
mesh = Mesh(<mesh referenced from the Rhino model>)

# ----
interval = Panel("30.0")
thickness = Panel("2.5")
toggle = BooleanToggle(False)
extension = Panel("10.0")

Y = UnitY(Factor=1)
X = UnitX(Factor=1)
pl = PlaneNormal(Origin=Point(0, 0, 0), ZAxis=Y)
pl_2 = PlaneNormal(Origin=Point(0, 0, 0), ZAxis=X)
contour = Contour(Shape=mesh, Point=Point(0, 0, 0), Direction=pl_2, Distance=interval)  # -> flatten(Contours)
contour_2 = Contour(Shape=mesh, Point=Point(0, 0, 0), Direction=pl, Distance=interval)  # -> flatten(Contours)

# ---- group: v_surfaces
boundary = BoundarySurfaces(Edges=contour)

# ---- group: u_surfaces
boundary_2 = BoundarySurfaces(Edges=contour_2)

# ----
srf = Surface(boundary_2)
srf_2 = Surface(boundary)

bbx = BrepBrep(BrepA=graft(srf), BrepB=srf_2, UseTasks=True)  # -> reparameterize(simplify(Curves)), Points
shatter = Shatter(Curve=bbx.Curves, Parameters="0.5")  # -> simplify(Segments)
item = ListItem(List=shatter, Index=0, Wrap=True)  # -> Item, Item1

entwine = Entwine(Branch00=srf, Branch01=srf_2, FlattenInputs=True)
evalsrf = EvaluateSurface(Surface=reparameterize(entwine), Point="0.5, 0.5")  # -> Point, Normal, UDirection, VDirection, Frame
amp = Amplitude(Vector=evalsrf.Normal, Amplitude=thickness)
division = Division(A=amp, B="2")
neg = Negative(Value=division)
move = Move(Geometry=entwine, Motion=neg)  # -> Geometry, Transform
extr = Extrude(Base=move.Geometry, Direction=amp)
bang = ExplodeTree(Data=extr)  # -> Branch0, Branch1

# ---- group: lines for cutting u_surfaces
line = Line(item.Item1)

# ---- group: lines for cutting v_surfaces
line_2 = Line(item.Item)

# ----
lng = ListLength(List=bbx.Curves)
sort = SortList(Keys=flatten(lng))  # -> Keys, ValuesA
trim = TrimTree(Tree=line, Depth=1)
trim_2 = TrimTree(Tree=line_2, Depth=1)
item_2 = ListItem(List=sort.Keys, Index=0, Wrap=True)  # -> Item1, Item
path_mapper = PathMapper(trim_2, source="{a; b}", target="{b}")
path_mapper_2 = PathMapper(trim_2, source="{a}(i)", target="{i}(a)")
trim_3 = TrimTree(Tree=trim, Depth=1)
panel = Panel(item_2.Item1)
equals = Equality(FirstNumber=item_2.Item1, SecondNumber="1")  # -> Equality, Inequality
filter = StreamFilter(Gate=equals.Equality, Stream0=trim_3, Stream1=trim)
filter_2 = StreamFilter(Gate=equals.Equality, Stream0=path_mapper, Stream1=path_mapper_2)

flip = FlipCurve(Curve=filter_2)  # -> Curve, Flag
end = EndPoints(Curve=filter)  # -> Start, End
bang_2 = ExplodeTree(Data=evalsrf.Normal)  # -> Branch0, Branch1
end_2 = EndPoints(Curve=flip.Curve)  # -> Start, End
pl_3 = ConstructPlane(Origin=end.Start, XAxis=graft(bang_2.Branch0), YAxis=bang_2.Branch1)
pl_4 = ConstructPlane(Origin=end_2.Start, XAxis=bang_2.Branch0, YAxis=graft(bang_2.Branch1))

ext = ExtendCurve(Curve=flip.Curve, Type=0, Start=extension, End="0.0")
ext_2 = ExtendCurve(Curve=filter, Type=0, Start="0.0", End=extension)
division_2 = Division(A=thickness, B="2")
neg_2 = Negative(Value=division_2)
dom = ConstructDomain(DomainStart=neg_2, DomainEnd=division_2)
rectangle = Rectangle(Plane=pl_4, XSize=dom, YSize=dom, Radius=0)  # -> Rectangle, Length
rectangle_2 = Rectangle(Plane=pl_3, XSize=dom, YSize=dom, Radius=0)  # -> Rectangle, Length
extrcrv = ExtrudeAlong(Base=rectangle.Rectangle, Curve=ext)
extrcrv_2 = ExtrudeAlong(Base=rectangle_2.Rectangle, Curve=ext_2)
cap = CapHoles(Brep=extrcrv)
cap_2 = CapHoles(Brep=extrcrv_2)

filter_3 = StreamFilter(Gate=toggle, Stream1=bang.Branch0)
filter_4 = StreamFilter(Gate=toggle, Stream1=bang.Branch1)

sdiff = SolidDifference(BrepsA=graft(filter_4), BrepsB=cap)  # -> flatten(Result)
sdiff_2 = SolidDifference(BrepsA=graft(filter_3), BrepsB=cap_2)  # -> flatten(Result)
merge = Merge(Data1=sdiff_2, Data2=sdiff)
debrep = DeconstructBrep(Brep=merge)  # -> Faces, Edges, Vertices
area = Area(Geometry=debrep.Faces)  # -> Area, Centroid
sort_2 = SortList(Keys=area.Area, ValuesA=debrep.Faces)  # -> Keys, ValuesA
item_3 = ListItem(List=sort_2.ValuesA, Index=0, Wrap=True)  # -> flatten(Item1), Item
unroll = UnrollBrep(Brep=item_3.Item1, JoinUnrolled=False)
debrep_2 = DeconstructBrep(Brep=unroll)  # -> Faces, Edges, Vertices
join = JoinCurves(Curves=debrep_2.Edges, Preserve=False)
group = Group(Objects=join)
